# Dynamo graph Home.dyn (Dynamo 2.13.1.3887)

categories = Categories("OST_Rooms")
all_elements_of_category = ElementsOfCategory(Category=categories)
finishBoundary = Room.FinishBoundary(room=all_elements_of_category)
