# Dynamo graph Home1.dyn (Dynamo 2.13.1.3887)
# packages: archi-lab.net 2023.213.1722

categories = Categories("OST_Rooms")
all_elements_of_category = ElementsOfCategory(Category=categories)
dropdown_list_selector = DropdownListSelector(List=all_elements_of_category, ItemsCollection=[{Name: "Room", Index: 0, IsSelected: false}, {Name: "Room", Index: 1, IsSelected: true}, {Name: "Room", Index: 2, IsSelected: false}])
watch = Watch(dropdown_list_selector)
finishBoundary = Room.FinishBoundary(room=dropdown_list_selector)
python_script = Python()  # CPython3; unwired: IN[0]; starter script, not edited (OUT = 0)
